# Dynamo graph 05_Write-CA-Legend.dyn (Dynamo 2.16.4.10216)

# group: Current Project
current = Document.Current()
filePath = Document.FilePath(document=current)

# group: Return the Folder of the Current Project
code_block = CodeBlock { "\\"; }
code_block_2 = CodeBlock { "\\"; }
split = String.Split(string=filePath, separator0=code_block_2)
code_block_3 = CodeBlock { -1; }
dropItems = List.DropItems(list=split, amount=code_block_3)
join = String.Join(separator=code_block, string0=dropItems)

# group: Master Check Template Location
file_path = Filename("Templates\02_Master-Check.xlsx")
file_from_path = FileObject(path=file_path)
string_from_object = FromObject(object=file_from_path)

# group: Return the File Name of the Master Check Template
code_block_4 = CodeBlock { "\\"; }
code_block_5 = CodeBlock { "\\"; }
split_2 = String.Split(string=string_from_object, separator0=code_block_5)
lastItem = List.LastItem(list=split_2)
join_2 = String.Join(separator=code_block_4, string0=lastItem)

# group: Combine Into the Current Project Path and Template Name for Master Check
code_block_6 = CodeBlock { "\\"; }
combinePath = FileSystem.CombinePath(string0=join, string1=join_2)
join_3 = String.Join(separator=code_block_6, string0=combinePath)

# group: Read from Takeoff Excel
file_from_path_2 = FileObject(path=join_3)
string = StringInput("CA")
boolean = BoolSelector(true)
boolean_2 = BoolSelector(true)
importExcel = Data.ImportExcel(file=file_from_path_2, sheetName=string, readAsStrings=boolean, showExcel=boolean_2)

code_block_7 = CodeBlock { 1; }
flatten = List.Flatten(list=importExcel, amount=code_block_7)
python_script = Python(IN[0]=flatten)  # CPython3
# ---------- python_script.python (36 lines) ----------
# Input from Excel Import Node (flattened data)
excel_data = IN[0]

# Initialize an empty list to hold the data in the desired list of lists format
data_rows = []

try:
    # Iterate through each row in the Excel data
    for row in excel_data:
        # Ensure row is a list and has meaningful data in the first six fields (Header, SubHeader, Type, Existing, Proposed, Variation)
        if isinstance(row, list) and len(row) >= 6:
            # Extract and format the required data, providing sensible default values where necessary
            header = row[0] if row[0] is not None else "N/A"
            sub_header = row[1] if row[1] is not None else "N/A"
            item_type = row[2] if row[2] is not None else "N/A"
            existing = row[3] if row[3] is not None else 0
            proposed = row[4] if row[4] is not None else 0
            variation = row[5] if row[5] is not None else 0

            # Only include rows with meaningful sub-header data (ignore entirely empty rows)
            if sub_header != "N/A":
                # Create a list for the row, keeping fields in the correct order
                row_list = [header, sub_header, item_type, existing, proposed, variation]

                # Append the row list to the data rows
                data_rows.append(row_list)

    # Set output to the list of lists
    if not data_rows:
        OUT = "No valid rows found in input data. Check the structure of the input or revise the extraction logic."
    else:
        OUT = data_rows

except Exception as e:
    # Output any errors that occur
    OUT = "Error occurred: {}".format(str(e))
# ----------------------------------------
watch = Watch(python_script)

# group: Sub-Header in Excel
python_script_2 = Python(IN[0]=watch)  # CPython3; frozen; unwired: IN[1]
# ---------- python_script_2.python (81 lines) ----------
import clr
clr.AddReference("RevitAPI")
clr.AddReference("RevitServices")
from Autodesk.Revit.DB import *
from RevitServices.Persistence import DocumentManager
import re

# Inputs
doc = DocumentManager.Instance.CurrentDBDocument
legend_views = IN[0]  # List of Legend View inputs, expected to be a list with one or more elements

# Check and handle if the input is in the expected format
if isinstance(legend_views, list) and len(legend_views) > 0:
    # Extract the first element (assuming it is a Legend View)
    legend_view = UnwrapElement(legend_views[0])
else:
    # If the input does not match the expected format, return an error message
    OUT = "Error: Expected a list with at least one Legend View."
    # Prevent the rest of the code from executing if input is incorrect
    import sys
    sys.exit()

# Proceed with the rest of the script
target_sub_header_text = IN[1]  # The sub-header text to extract (e.g., "MULTI-DECK FROZEN FOOD")

# Collect all TextNote elements in the Legend View
collector = FilteredElementCollector(doc, legend_view.Id).OfClass(TextNote)
text_notes = []

for text_note in collector:
    location = text_note.Coord  # XYZ location of the Text Note
    element_data = {
        "ElementId": text_note.Id.IntegerValue,
        "Text": text_note.Text,
        "Location": location
    }
    text_notes.append(element_data)

# Preprocess the target text to remove extra whitespace and normalize line breaks
target_sub_header_text_clean = re.sub(r'\s+', ' ', target_sub_header_text.strip()).upper()

# Group text notes by rows (based on Y-coordinate)
tolerance = 0.1  # Tolerance for determining whether two text notes are in the same row
rows = []

for text_note in text_notes:
    y_coord = text_note["Location"].Y
    found_row = False
    for row in rows:
        if abs(row[0]["Location"].Y - y_coord) < tolerance:
            row.append(text_note)
            found_row = True
            break
    if not found_row:
        rows.append([text_note])

# Sort rows by Y-coordinate (descending order for top to bottom)
sorted_rows = sorted(rows, key=lambda r: -r[0]["Location"].Y)

# Sort elements within each row by X-coordinate (ascending order for left to right)
for row in sorted_rows:
    row.sort(key=lambda e: e["Location"].X)

# Find the row that matches the target sub-header text
target_row_data = None

for row in sorted_rows:
    # Check each element in the row to find the target text
    for element in row:
        element_text_clean = re.sub(r'\s+', ' ', element["Text"].strip()).upper()
        if element_text_clean == target_sub_header_text_clean:
            target_row_data = row
            break
    if target_row_data:
        break

# Output the matched row (sub-header row) if found, otherwise output a helpful message
if target_row_data:
    OUT = target_row_data
else:
    OUT = f"No matching sub-header found for: '{target_sub_header_text}'."
# ----------------------------------------

watch_2 = Watch(python_script_2)
watch_3 = Watch(flatten)

# group: PRODUCE
code_block_8 = CodeBlock { "MULTI-DECK PRODUCE"; }

# group: BEVERAGE
code_block_9 = CodeBlock { "MULTI-DECK SINGLE SERVE BEV"; }

# group: SERVICE DELI
code_block_10 = CodeBlock { "SERVICE DELI COLD CASE"; }
code_block_11 = CodeBlock { "SERVICE DELI HOT CASE"; }
code_block_12 = CodeBlock { "SUSHI"; }
code_block_13 = CodeBlock { "SERVICE SANDWICH"; }
code_block_14 = CodeBlock { "LOW PROFILE DELI CASE"; }
code_block_15 = CodeBlock { "MULTI-DECK DELI CASE"; }

# group: DAIRY & MEAT / DELI
code_block_16 = CodeBlock { "DAIRY COOLER DOORS (DOOR QTY x 2.5)"; }
code_block_17 = CodeBlock { "MULTI-DECK MEAT DELI"; }
code_block_18 = CodeBlock { "TOTAL MULTI-DECK DAIRY & MEAT/DELI"; }

# group: SEAFOOD & MEAT
code_block_19 = CodeBlock { "SERVICE SEAFOOD"; }
code_block_20 = CodeBlock { "SERVICE MEAT"; }
code_block_21 = CodeBlock { "MULTI-DECK MEAT"; }

code_block_22 = CodeBlock { "WINE / LIQUOR SHELVING"; }

# group: TAB
code_block_23 = CodeBlock { "MULTI-DECK BEER / WINE"; }
code_block_24 = CodeBlock { "MULTI-DECK PREMIUM WINE"; }
wine_liquor_lf = CodeBlock(X=code_block_22) { X; }
wine_liquor_slf = CodeBlock(X=code_block_22) { X; }

# group: FROZEN FOOD
code_block_25 = CodeBlock { "MULTI-DECK FROZEN FOOD"; }
code_block_26 = CodeBlock { "MULTI-DECK FROZEN PROMO"; }
code_block_27 = CodeBlock { "MULTI-DECK SEAFOOD & MEAT"; }
code_block_28 = CodeBlock()
# ---------- code_block_28.designscript (2 lines) ----------
"TOTAL FROZEN FOOD
(NUMBER OF DOORS)";
# ----------------------------------------

# group: SHELVING
code_block_29 = CodeBlock { "CENTER STORE SHELVING"; }
wine_liquor_lf_2 = CodeBlock(X=code_block_22) { X; }
code_block_30 = CodeBlock { "TOTAL SHELVING"; }

process_revit_legend = Python(IN[1]=code_block_8, IN[2]=code_block_9, IN[3]=code_block_10, IN[4]=code_block_11, IN[5]=code_block_12, IN[6]=code_block_13, IN[7]=code_block_14, IN[8]=code_block_15, IN[9]=code_block_16, IN[10]=code_block_17, IN[11]=code_block_18, IN[12]=code_block_19, IN[13]=code_block_20, IN[14]=code_block_21, IN[15]=code_block_23, IN[16]=code_block_24, IN[17]=wine_liquor_lf, IN[18]=wine_liquor_slf, IN[19]=code_block_25, IN[20]=code_block_26, IN[21]=code_block_27, IN[22]=code_block_28, IN[23]=code_block_29, IN[24]=wine_liquor_lf_2, IN[25]=code_block_30)  # CPython3; unwired: IN[0]; empty script

# group: Extract Revit Legend
code_block_31 = CodeBlock { "DSP Comp Ref (Portrait)"; }
code_block_32 = CodeBlock { "DSP Comp Ref (Landscape)"; }
list_create = List.Create(item0=code_block_31, item1=code_block_32)
get_legends = Python(IN[0]=list_create)  # CPython3
# ---------- get_legends.python (45 lines) ----------
import clr
clr.AddReference("RevitAPI")
clr.AddReference("RevitServices")
from Autodesk.Revit.DB import *
from RevitServices.Persistence import DocumentManager

# Inputs
doc = DocumentManager.Instance.CurrentDBDocument

# Check if input is received
if len(IN) < 1 or not IN[0]:
    OUT = "Error: Please provide a list of legend names."
    raise SystemExit

# List of legend names to find
legend_names = IN[0]

# Ensure the input is a list of strings
if not isinstance(legend_names, list) or not all(isinstance(name, str) for name in legend_names):
    OUT = "Error: Input must be a list of strings representing legend names."
    raise SystemExit

# Get all views in the document
collector = FilteredElementCollector(doc).OfClass(View)

# Filter Legends
matching_legends = []
non_matching_legends = []
for view in collector:
    if view.ViewType == ViewType.Legend:
        if view.Name.strip() in [name.strip() for name in legend_names]:
            # Append name and Element ID for matching legends
            matching_legends.append([view.Name, view.Id.IntegerValue])
        else:
            # Append name and Element ID for non-matching legends
            non_matching_legends.append([view.Name, view.Id.IntegerValue])

# Prepare Output
output_list = [
    ["Matching Legends", matching_legends],
    ["Non-Matching Legends", non_matching_legends]
]

# Output the results
OUT = output_list
# ----------------------------------------
code_block_33 = CodeBlock { 1; }
getItemAtIndex = List.GetItemAtIndex(list=get_legends@L2, index=code_block_33)
code_block_34 = CodeBlock { 1; }
getItemAtIndex_2 = List.GetItemAtIndex(list=getItemAtIndex@L2, index=code_block_34)
extract_textnotes = Python(IN[0]=getItemAtIndex_2)  # CPython3
# ---------- extract_textnotes.python (51 lines) ----------
import clr
clr.AddReference('RevitServices')
from RevitServices.Persistence import DocumentManager
clr.AddReference("RevitAPI")
from Autodesk.Revit.DB import *

# Input Legend ID
legend_id = IN[0][0]

# Access the current Revit document
doc = DocumentManager.Instance.CurrentDBDocument

# Placeholder for output
text_notes = []

try:
    # Validate that the input is a valid integer before converting to ElementId
    if isinstance(legend_id, int):
        # Try to convert legend_id to an ElementId
        legend_element_id = ElementId(legend_id)
        
        # Get the Legend View from the document
        legend_view = doc.GetElement(legend_element_id)

        # Check if the view is a Legend type
        if isinstance(legend_view, View) and legend_view.ViewType == ViewType.Legend:
            # Collect all text notes within the legend view
            collector = FilteredElementCollector(doc, legend_view.Id)
            text_elements = collector.OfCategory(BuiltInCategory.OST_TextNotes).WhereElementIsNotElementType().ToElements()
            
            # Extract text, Legend Index, position, and index from each TextNote element
            for index, text_element in enumerate(text_elements, start=1):
                if isinstance(text_element, TextNote):
                    text = text_element.Text.strip()
                    location = text_element.Coord  # Get XYZ position
                    text_notes.append([
                        text,
                        [
                            "Legend Index", index,
                            ["Position", location.X, location.Y, location.Z]
                        ]
                    ])
        else:
            text_notes.append(["Error: The provided ID does not correspond to a Legend View."])
    else:
        text_notes.append(["Error: Invalid input type. Please provide a valid integer ID."])
except Exception as e:
    text_notes.append([f"Error: An error occurred: {str(e)}"])

# Output the collected text notes
OUT = text_notes
# ----------------------------------------

watch_4 = Watch(extract_textnotes)
group_into_columns = Python(IN[0]=extract_textnotes)  # CPython3
# ---------- group_into_columns.python (33 lines) ----------
import clr

# Input data from Dynamo (a complete list containing all data)
input_data = IN[0]  # List of lists containing TextNote, Legend Index, and Position data

# Extracted values
text_notes = []
legend_indices = []
y_positions = []

debug_info = []

# Iterate over each item in the input data and extract the needed values
for item in input_data:
    try:
        text_note = item[0]  # TextNote label
        legend_index = item[1][1]  # Legend Index value
        y_position = item[1][2][1]  # Y Position value

        # Append the extracted values to respective lists
        text_notes.append(text_note)
        legend_indices.append(legend_index)
        y_positions.append(y_position)
    except (IndexError, TypeError) as e:
        debug_info.append(f"Error processing item {item}: {e}")

# Output the extracted values and debug information
OUT = {
    "TextNotes": text_notes,
    "LegendIndices": legend_indices,
    "YPositions": y_positions,
    "DebugInfo": debug_info
}
# ----------------------------------------
watch_5 = Watch(group_into_columns)
